# Grasshopper definition Evacuation.gh (Grasshopper 1.0.9)

panel = Panel("C:\Users\robin\OneDrive - University College London\AC\Final Thesis\Prototype_2_test0.sqlite")
path = FilePath("C:\Users\robin\OneDrive - University College London\AC\Final Thesis\corner.sqlite")
number_slider = Slider(10, range=0..100)  # disabled
number_slider_2 = Slider(18, range=0..100)  # disabled
number_slider_3 = Slider(1, range=0..3)  # disabled
number_slider_4 = Slider(4, range=0..10)  # disabled
number_slider_5 = Slider(1.5, range=0..10)  # disabled
number_slider_6 = Slider(9, range=0..49)  # disabled
number_slider_7 = Slider(0.8, range=0..1)  # disabled
toggle = BooleanToggle(True)  # disabled
button = Button()  # disabled
toggle_2 = BooleanToggle(True)  # disabled
button_2 = Button()  # disabled
crv = Curve([<curve referenced from the Rhino model> x42])
crv_2 = Curve([<curve referenced from the Rhino model> x16])  # disabled
# how to evaluete the efficiency
# at least one floor layout
# where stuck
trigger = Trigger(Interval=1, TimerInterval=5, Target=py3_2)  # disabled
crv_3 = Curve(<curve referenced from the Rhino model>)
crv_4 = Curve([<curve referenced from the Rhino model> x41])
crv_5 = Curve([<curve referenced from the Rhino model> x2])
# how to evaluete the efficiency
# at least one floor layout
# where stuck
trigger_2 = Trigger(Interval=1, TimerInterval=5, Target=py3_3)  # disabled
crv_6 = Curve(<curve referenced from the Rhino model>)  # disabled
pt = Point([Point(11.8495535, 40.64538444, 0), Point(13.25529295, 41.04953453, 0), Point(18.80796379, 40.7508149, 0), Point(12.05655239, 23.95336201, 0), Point(13.8499245, 23.98894479, 0), Point(16.06874331, 23.74329892, 0)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])
crv_7 = Curve(<curve referenced from the Rhino model>)  # disabled
crv_8 = Curve(<curve referenced from the Rhino model>)  # disabled
path_2 = FilePath("C:\Users\robin\OneDrive - University College London\AC\Final Thesis\corner.sqlite")  # disabled
crv_9 = Curve([<curve referenced from the Rhino model> x18])  # disabled
crv_10 = Curve(<curve referenced from the Rhino model>)  # disabled
crv_11 = Curve(<curve referenced from the Rhino model>)  # disabled
path_3 = FilePath("C:\Users\robin\OneDrive - University College London\AC\Final Thesis\corner.sqlite")  # disabled
trigger_3 = Trigger(Interval=1, TimerInterval=5, Target=py3)  # disabled
py3 = Python3Script(
    run=toggle,
    reset=button,
    boundary_crv=crv_6,
    start_crv=crv_7,
    exit_crv=crv_8,
    num_agents=number_slider,
    trajectory_file_path=path_2,
    mean_speed=number_slider_4,
    speed_std=number_slider_5)  # -> out, Area_Geo, Agent_Geo, sim_active; inputs run: Boolean, reset: Boolean, boundary_crv: Curve, obstacles_crvs: list of Curve, start_crv: Curve, exit_crv: Curve, num_agents: Int32, trajectory_file_path: String, mean_speed: Double, speed_std: Double; disabled
# ---------- py3: Python ----------
# -*- coding: utf-8 -*-
# Final, robust script for trigger-based simulation in Grasshopper

import scriptcontext as sc
import Rhino.Geometry as rg
from shapely.geometry import Polygon
import jupedsim as jps
from numpy.random import normal
import pathlib

# ==============================================================================
# Helper Functions
# ==============================================================================

def curve_to_polygon(crv):
    """Converts a closed Rhino Curve to a shapely Polygon."""
    if not crv or not crv.IsClosed: return None
    res, polyline = crv.TryGetPolyline()
    if not res: return None
    return Polygon([(pt.X, pt.Y) for pt in polyline])

def poly_to_rhino_surface(polygon):
    """Converts a shapely Polygon (with potential holes) to Rhino Breps."""
    if not polygon: return None
    outer_crv = rg.Polyline([rg.Point3d(x, y, 0) for x, y in polygon.exterior.coords]).ToNurbsCurve()
    inner_crvs = [rg.Polyline([rg.Point3d(x, y, 0) for x, y in interior.coords]).ToNurbsCurve() for interior in polygon.interiors]
    breps = rg.Brep.CreatePlanarBreps([outer_crv] + inner_crvs, 0.01)
    return list(breps) if breps else []

# ==============================================================================
# Main Script Logic
# ==============================================================================

# --- Handle Reset ---
# This has priority and will clear the simulation state.
if reset and 'sim_instance' in sc.sticky:
    sc.sticky.pop('sim_instance')
    print("Simulation Reset.")

# --- Handle Initialization ---
# This runs only once when 'run' is True and no simulation exists.
if run and 'sim_instance' not in sc.sticky:
    print("Initializing simulation...")
    
    # Input validation
    if all([boundary_crv, start_crv, exit_crv, trajectory_file_path]):
        # Geometry conversion
        area = curve_to_polygon(boundary_crv)
        spawning_area = curve_to_polygon(start_crv)
        exit_area = curve_to_polygon(exit_crv)
        
        if all([area, spawning_area, exit_area]):
            # Simulation setup
            traj_path = pathlib.Path(trajectory_file_path)
            traj_path.parent.mkdir(parents=True, exist_ok=True)
            model = jps.SocialForceModel()
            
            simulation = jps.Simulation(
                model=model, geometry=area,
                trajectory_writer=jps.SqliteTrajectoryWriter(output_file=traj_path)
            )
            
            # Define journey and create agents
            exit_id = simulation.add_exit_stage(exit_area.exterior.coords[:-1])
            journey_id = simulation.add_journey(jps.JourneyDescription([exit_id]))
            positions = jps.distributions.distribute_by_number(
                polygon=spawning_area, number_of_agents=num_agents,
                distance_to_agents=0.4, distance_to_polygon=0.2, seed=1
            )
            speeds = normal(mean_speed, speed_std, num_agents)

            #parameter
            for pos, v0 in zip(positions, speeds):
                simulation.add_agent(
                        jps.SocialForceModelAgentParameters(
                        journey_id=journey_id, stage_id=exit_id,
                        position=pos, desired_speed=v0,
                    )
                )
            
            sc.sticky['sim_instance'] = simulation
            print("Initialization complete.")

# --- Initialize outputs for this run ---
Agent_Geo = []
sim_active = False
out = "Idle."

# --- Main simulation and output logic ---
simulation = sc.sticky.get('sim_instance')

if simulation:
    if simulation.agent_count() > 0:
        if run:
            simulation.iterate()
        
        agents = simulation.agents()
        Agent_Geo = [rg.Point3d(agent.position[0], agent.position[1], 0) for agent in agents]
        
        status = "Running" if run else "Paused"
        out = "{} | Step: {} | Agents: {}".format(status, simulation.iteration_count(), simulation.agent_count())
        sim_active = True
        
        if run and simulation.agent_count() == 0:
            out = "Simulation Complete! | Steps: {}".format(simulation.iteration_count())
            sim_active = False
            sc.sticky.pop('sim_instance')
    else:
        out = "Simulation Complete! Press 'reset' to start over."
        sim_active = False
        if 'sim_instance' in sc.sticky:
            sc.sticky.pop('sim_instance')
else:
    out = "Ready. Set 'run' to True to initialize."
    
# --- Always prepare visualization geometry for output ---
Area_Geo = []
area_srf = poly_to_rhino_surface(curve_to_polygon(boundary_crv))
start_srf = poly_to_rhino_surface(curve_to_polygon(start_crv))
exit_srf = poly_to_rhino_surface(curve_to_polygon(exit_crv))
if area_srf: Area_Geo.extend(area_srf)
if start_srf: Area_Geo.extend(start_srf)
if exit_srf: Area_Geo.extend(exit_srf)
# ---------- end py3 ----------
py3_2 = Python3Script(
    run=Toggle(True),
    reset=Button(),
    model_index=Slider(0, range=0..3),
    boundary_crv=crv_3,
    obstacles_crvs=crv,
    start_crvs=crv_4,
    exit_crvs=crv_5,
    num_agents=Slider(31, range=0..100),
    agents_points=pt,
    trajectory_file_path=panel,
    speed=Slider(0.8, range=0..1),
    skip_frames=Slider(49, range=0..49))  # -> out, Agent_Geo, sim_active, elapsed_time, agent_counts; inputs run: Boolean, reset: Boolean, model_index: Int32, boundary_crv: Curve, obstacles_crvs: list of Curve, start_crvs: list of Curve, exit_crvs: list of Curve, num_agents: Int32, agents_points: list of Point3d, trajectory_file_path: String, speed: Double, skip_frames: Int32
# ---------- py3_2: Python ----------
# -*- coding: utf-8 -*-
# Final, robust script for trigger-based simulation in Grasshopper
import shapely as sp
import scriptcontext as sc
import Rhino.Geometry as rg
from shapely.geometry import Polygon
from shapely.geometry import Point
import jupedsim as jps
from numpy.random import normal
import pathlib
import random as rnd

# ==============================================================================
# Helper Functions
# ==============================================================================

def curve_to_polygon(crv):
    """Converts a closed Rhino Curve to a shapely Polygon."""
    if not crv or not crv.IsClosed: return None
    res, polyline = crv.TryGetPolyline()
    if not res: return None
    return Polygon([(pt.X, pt.Y) for pt in polyline])

def poly_to_rhino_surface(polygon):
    """Converts a shapely Polygon (with potential holes) to Rhino Breps."""
    if not polygon: return None
    outer_crv = rg.Polyline([rg.Point3d(x, y, 0) for x, y in polygon.exterior.coords]).ToNurbsCurve()
    inner_crvs = [rg.Polyline([rg.Point3d(x, y, 0) for x, y in interior.coords]).ToNurbsCurve() for interior in polygon.interiors]
    breps = rg.Brep.CreatePlanarBreps([outer_crv] + inner_crvs, 0.01)
    return list(breps) if breps else []

def point3d_to_tuple(point):
    if not point: return None
    return (point.X, point.Y)

models = [
    jps.CollisionFreeSpeedModel(),
    jps.CollisionFreeSpeedModelV2(),
    jps.AnticipationVelocityModel(),
    jps.SocialForceModel(),
    jps.GeneralizedCentrifugalForceModel]
modelparams = [
    jps.CollisionFreeSpeedModelAgentParameters,
    jps.CollisionFreeSpeedModelV2AgentParameters,
    jps.AnticipationVelocityModelAgentParameters,
    jps.SocialForceModelAgentParameters,
    jps.GeneralizedCentrifugalForceModelAgentParameters]

time_step = 0.1

# ==============================================================================
# Main Script Logic
# ==============================================================================

# --- Handle Reset ---
# This has priority and will clear the simulation state.
if reset:
    if 'sim_instance' in sc.sticky: sc.sticky.pop('sim_instance')
    if 'sim_model' in sc.sticky: sc.sticky.pop('sim_model')
    if 'sim_completed' in sc.sticky: sc.sticky.pop('sim_completed')
    if 'final_time' in sc.sticky: sc.sticky.pop('final_time') 
    print("Simulation Reset by user.")

# --- Handle Initialization ---
# This runs only once when 'run' is True and no simulation exists.

if run and 'sim_instance' not in sc.sticky and 'sim_completed' not in sc.sticky:
    print("Initializing simulation...")
    
    # Input validation
    if all([boundary_crv, start_crvs, exit_crvs, trajectory_file_path]):
        # Geometry conversion
        area = curve_to_polygon(boundary_crv)
        obstacles = [curve_to_polygon(obstacle) for obstacle in obstacles_crvs]

        obstacles = sp.unary_union(obstacles)
        area = area.difference(obstacles)

        spawning_areas = [curve_to_polygon(crv) for crv in start_crvs]
        exit_areas = [curve_to_polygon(crv) for crv in exit_crvs]

        model = models[model_index]
        
        if all([area, spawning_areas, exit_areas]):
            # Simulation setup
            traj_path = pathlib.Path(trajectory_file_path)
            traj_path.parent.mkdir(parents=True, exist_ok=True)
            
            simulation = jps.Simulation(
                model=model, geometry=area,
                trajectory_writer=jps.SqliteTrajectoryWriter(output_file=traj_path)
            )
            
            # Collect ID of all exits---
            exit_to_poly_map = {}
            exit_to_journey_map = {}

            for exit_poly in exit_areas:

                exit_id = simulation.add_exit_stage(exit_poly.exterior.coords[:-1])

                journey = jps.JourneyDescription([exit_id])
                journey_id = simulation.add_journey(journey)
                
                exit_to_poly_map[exit_id] = exit_poly
                exit_to_journey_map[exit_id] = journey_id

            # Create ppl in all spawning areas
            all_positions = []
            all_speeds = []
            total_area = sum(p.area for p in spawning_areas)
            agents_created = 0

            if agents_points:
                print("Using provided points for agent positions.")
                all_positions = [point3d_to_tuple(point) for point in agents_points]
            
            else:
                print("Generating agent positions randomly in spawning areas.")
                total_area = sum(p.area for p in spawning_areas)
                agents_created = 0

                for i, poly in enumerate(spawning_areas):
                    if total_area > 0:
                        ratio = poly.area / total_area
                        if i == len(spawning_areas) - 1:
                            agents_for_this_poly = num_agents - agents_created
                        else:
                            agents_for_this_poly = int(round(num_agents * ratio))
                    else: 
                        agents_for_this_poly = num_agents // len(spawning_areas)
                    
                    if agents_for_this_poly <= 0: continue

                    positions = jps.distributions.distribute_by_number(
                        polygon=poly.buffer(-0.05), # 增加安全边界
                        number_of_agents=agents_for_this_poly,
                        distance_to_agents=0.2, distance_to_polygon=0.2, seed=i
                    )
                    
                    all_positions.extend(positions)
                    agents_created += len(positions)
            
            print("Total agents created: {}".format(len(all_positions)))
            
            #parameter
            #add all agents into simulation

            for pos in all_positions:
                
                # 1. Create pedestrian shaply point
                agent_point = Point(pos)
                
                # 2. Calculate all the points to exit
                # min() to find the smallest key
                closest_exit_id = min(
                    exit_to_poly_map.keys(),
                    key=lambda exit_id: agent_point.distance(exit_to_poly_map[exit_id])
                )
                
                # 3. find the shortest journey from dictionary
                assigned_journey_id = exit_to_journey_map[closest_exit_id]
                
                model_name = type(model).__name__

                if model_name == "AnticipationVelocityModel":
                    agent_params = modelparams[model_index](
                        journey_id=assigned_journey_id,
                        stage_id=closest_exit_id,
                        position=pos,
                        desired_speed=speed,
                        # --- 
                        time_gap=time_step,
                        radius=0.2,
                        strength_neighbor_repulsion=2.0,
                        range_neighbor_repulsion=0.1,
                        wall_buffer_distance=0.1,
                        anticipation_time=1.0,
                        reaction_time=0.2
                    )
                elif model_name == "SocialForceModel":
                    agent_params = modelparams[model_index](
                        journey_id=assigned_journey_id,
                        stage_id=closest_exit_id,
                        position=pos,
                        desired_speed=speed,
                        # --- 
                        #obstacle_scale=2000, 
                        #force_distance=2000 
                    )
                else: # CollisionFreeSpeedModel & V2 
                    agent_params = modelparams[model_index](
                        journey_id=assigned_journey_id,
                        stage_id=closest_exit_id,
                        position=pos,
                        desired_speed=speed
                    )

                #
                simulation.add_agent(agent_params)

        
            sc.sticky['sim_instance'] = simulation
            print("Initialization complete.")

# --- Initialize outputs for this run ---
Agent_Geo = []
sim_active = False
out = "Idle."
elapsed_time = 0.0 # init time output

# --- Main simulation and output logic ---
simulation = sc.sticky.get('sim_instance')

if simulation:
    elapsed_time = simulation.iteration_count() * time_step

    if simulation.agent_count() > 0:
        if run:
            for _ in range(skip_frames + 1):
                if simulation.agent_count() == 0:
                    break
                simulation.iterate()

        agents = simulation.agents()
        agent_counts = simulation.agent_count()
        Agent_Geo = [rg.Point3d(agent.position[0], agent.position[1], 0) for agent in agents]
        
        status = "Running" if run else "Paused"
        out = "{} | Step: {} | Agents: {}".format(status, simulation.iteration_count(), simulation.agent_count())
        sim_active = True
        
        if run and simulation.agent_count() == 0:
            out = "Simulation Complete! | Steps: {} To run again, set 'run' to False, then back to True.".format(simulation.iteration_count())
            sim_active = False

    else: #finish the evacuation
        final_time = simulation.iteration_count() * time_step
        
        out = "Simulation Complete! Press 'reset' to start over."
        sim_active = False

        sc.sticky['sim_completed'] = True
        sc.sticky['final_time'] = final_time
        if 'sim_instance' in sc.sticky: sc.sticky.pop('sim_instance')

elif sc.sticky.get('sim_completed'):
    final_time = sc.sticky.get('final_time', 0.0)
    elapsed_time = final_time

    out = "Simulation Complete! Press 'reset' to start over."
    sim_active = False
else:
    out = "Ready. Set 'run' to True to initialize."
# ---------- end py3_2 ----------
py3_3 = Python3Script(
    run=toggle_2,
    reset=button_2,
    model_index=number_slider_3,
    boundary_crv=crv_11,
    obstacles_crvs=crv_2,
    start_crvs=crv_9,
    exit_crvs=crv_10,
    num_agents=number_slider_2,
    trajectory_file_path=path_3,
    speed=number_slider_7,
    skip_frames=number_slider_6)  # -> out, Agent_Geo, sim_active, elapsed_time; inputs run: Boolean, reset: Boolean, model_index: Int32, boundary_crv: Curve, obstacles_crvs: list of Curve, start_crvs: list of Curve, exit_crvs: list of Curve, num_agents: Int32, trajectory_file_path: String, speed: Double, skip_frames: Int32; disabled
# ---------- py3_3: Python ----------
# -*- coding: utf-8 -*-
# Final, robust script for trigger-based simulation in Grasshopper
import shapely as sp
import scriptcontext as sc
import Rhino.Geometry as rg
from shapely.geometry import Polygon
from shapely.geometry import Point
import jupedsim as jps
from numpy.random import normal
import pathlib
import random as rnd

# ==============================================================================
# Helper Functions
# ==============================================================================

def curve_to_polygon(crv):
    """Converts a closed Rhino Curve to a shapely Polygon."""
    if not crv or not crv.IsClosed: return None
    res, polyline = crv.TryGetPolyline()
    if not res: return None
    return Polygon([(pt.X, pt.Y) for pt in polyline])

def poly_to_rhino_surface(polygon):
    """Converts a shapely Polygon (with potential holes) to Rhino Breps."""
    if not polygon: return None
    outer_crv = rg.Polyline([rg.Point3d(x, y, 0) for x, y in polygon.exterior.coords]).ToNurbsCurve()
    inner_crvs = [rg.Polyline([rg.Point3d(x, y, 0) for x, y in interior.coords]).ToNurbsCurve() for interior in polygon.interiors]
    breps = rg.Brep.CreatePlanarBreps([outer_crv] + inner_crvs, 0.01)
    return list(breps) if breps else []

models = [
    jps.CollisionFreeSpeedModel(),
    jps.CollisionFreeSpeedModelV2(),
    jps.AnticipationVelocityModel(),
    jps.SocialForceModel(),
    jps.GeneralizedCentrifugalForceModel]
modelparams = [
    jps.CollisionFreeSpeedModelAgentParameters,
    jps.CollisionFreeSpeedModelV2AgentParameters,
    jps.AnticipationVelocityModelAgentParameters,
    jps.SocialForceModelAgentParameters,
    jps.GeneralizedCentrifugalForceModelAgentParameters]

time_step = 0.1

# ==============================================================================
# Main Script Logic
# ==============================================================================

# --- Handle Reset ---
# This has priority and will clear the simulation state.
if reset:
    if 'sim_instance' in sc.sticky: sc.sticky.pop('sim_instance')
    if 'sim_model' in sc.sticky: sc.sticky.pop('sim_model')
    if 'sim_completed' in sc.sticky: sc.sticky.pop('sim_completed')
    if 'final_time' in sc.sticky: sc.sticky.pop('final_time') 
    print("Simulation Reset by user.")

# --- Handle Initialization ---
# This runs only once when 'run' is True and no simulation exists.

if run and 'sim_instance' not in sc.sticky and 'sim_completed' not in sc.sticky:
    print("Initializing simulation...")
    
    # Input validation
    if all([boundary_crv, start_crvs, exit_crvs, trajectory_file_path]):
        # Geometry conversion
        area = curve_to_polygon(boundary_crv)
        obstacles = [curve_to_polygon(obstacle) for obstacle in obstacles_crvs]

        obstacles = sp.unary_union(obstacles)
        area = area.difference(obstacles)

        spawning_areas = [curve_to_polygon(crv) for crv in start_crvs]
        exit_areas = [curve_to_polygon(crv) for crv in exit_crvs]

        model = models[model_index]
        
        if all([area, spawning_areas, exit_areas]):
            # Simulation setup
            traj_path = pathlib.Path(trajectory_file_path)
            traj_path.parent.mkdir(parents=True, exist_ok=True)
            
            simulation = jps.Simulation(
                model=model, geometry=area,
                trajectory_writer=jps.SqliteTrajectoryWriter(output_file=traj_path)
            )
            
            # Collect ID of all exits---
            exit_to_poly_map = {}
            exit_to_journey_map = {}

            for exit_poly in exit_areas:

                exit_id = simulation.add_exit_stage(exit_poly.exterior.coords[:-1])

                journey = jps.JourneyDescription([exit_id])
                journey_id = simulation.add_journey(journey)
                
                exit_to_poly_map[exit_id] = exit_poly
                exit_to_journey_map[exit_id] = journey_id

            # Create ppl in all spawning areas
            all_positions = []
            all_speeds = []
            total_area = sum(p.area for p in spawning_areas)
            agents_created = 0

            for i, poly in enumerate(spawning_areas):
                if total_area > 0:
                    ratio = poly.area / total_area
                    if i == len(spawning_areas) - 1:
                        agents_for_this_poly = num_agents - agents_created
                    else:
                        agents_for_this_poly = int(round(num_agents * ratio))
                else: 
                    agents_for_this_poly = num_agents // len(spawning_areas)
                
                if agents_for_this_poly <= 0: continue

                # Positions
                positions = jps.distributions.distribute_by_number(
                    polygon=poly, number_of_agents=agents_for_this_poly,
                    distance_to_agents=0.2, distance_to_polygon=0.2, seed=i # use different seed
                )
                #speeds = normal(mean_speed, speed_std, len(positions))
                
                all_positions.extend(positions)
                #all_speeds.extend(speed)
                agents_created += len(positions)
            
            print("Total agents created: {}".format(len(all_positions)))
            
            #parameter
            #add all agents into simulation

            # 一次性将所有收集到的行人添加到模拟中
            for pos in all_positions:
                
                # 1. Create pedestrian shaply point
                agent_point = Point(pos)
                
                # 2. Calculate all the points to exit
                # min() to find the smallest key
                closest_exit_id = min(
                    exit_to_poly_map.keys(),
                    key=lambda exit_id: agent_point.distance(exit_to_poly_map[exit_id])
                )
                
                # 3. find the shortest journey from dictionary
                assigned_journey_id = exit_to_journey_map[closest_exit_id]
                
                model_name = type(model).__name__

                if model_name == "AnticipationVelocityModel":
                    agent_params = modelparams[model_index](
                        journey_id=assigned_journey_id,
                        stage_id=closest_exit_id,
                        position=pos,
                        desired_speed=speed,
                        # --- 
                        time_gap=time_step,
                        radius=0.2,
                        strength_neighbor_repulsion=2.0,
                        range_neighbor_repulsion=0.1,
                        wall_buffer_distance=0.1,
                        anticipation_time=1.0,
                        reaction_time=0.2
                    )
                elif model_name == "SocialForceModel":
                    agent_params = modelparams[model_index](
                        journey_id=assigned_journey_id,
                        stage_id=closest_exit_id,
                        position=pos,
                        desired_speed=speed,
                        # --- 
                        obstacle_scale=2000, 
                        force_distance=2000 
                    )
                else: # CollisionFreeSpeedModel & V2 
                    agent_params = modelparams[model_index](
                        journey_id=assigned_journey_id,
                        stage_id=closest_exit_id,
                        position=pos,
                        desired_speed=speed
                    )

                #
                simulation.add_agent(agent_params)

        
            sc.sticky['sim_instance'] = simulation
            print("Initialization complete.")

# --- Initialize outputs for this run ---
Agent_Geo = []
sim_active = False
out = "Idle."
elapsed_time = 0.0 # init time output

# --- Main simulation and output logic ---
simulation = sc.sticky.get('sim_instance')

if simulation:
    elapsed_time = simulation.iteration_count() * time_step

    if simulation.agent_count() > 0:
        if run:
            for _ in range(skip_frames + 1):
                if simulation.agent_count() == 0:
                    break
                simulation.iterate()

        agents = simulation.agents()
        Agent_Geo = [rg.Point3d(agent.position[0], agent.position[1], 0) for agent in agents]
        
        status = "Running" if run else "Paused"
        out = "{} | Step: {} | Agents: {}".format(status, simulation.iteration_count(), simulation.agent_count())
        sim_active = True
        
        if run and simulation.agent_count() == 0:
            out = "Simulation Complete! | Steps: {} To run again, set 'run' to False, then back to True.".format(simulation.iteration_count())
            sim_active = False

    else: #finish the evacuation
        final_time = simulation.iteration_count() * time_step
        
        out = "Simulation Complete! Press 'reset' to start over."
        sim_active = False

        sc.sticky['sim_completed'] = True
        sc.sticky['final_time'] = final_time
        if 'sim_instance' in sc.sticky: sc.sticky.pop('sim_instance')

elif sc.sticky.get('sim_completed'):
    final_time = sc.sticky.get('final_time', 0.0)
    elapsed_time = final_time

    out = "Simulation Complete! Press 'reset' to start over."
    sim_active = False
else:
    out = "Ready. Set 'run' to True to initialize."
# ---------- end py3_3 ----------
panel_2 = Panel(py3.sim_active)  # disabled
srf = Surface(py3.Area_Geo)  # disabled
pt_2 = Point(py3.Agent_Geo)  # disabled
panel_3 = Panel(py3_3.elapsed_time)  # disabled
panel_4 = Panel(py3_2.elapsed_time)
panel_5 = Panel(py3_2.agent_counts)
panel_6 = Panel(py3_2.sim_active)
panel_7 = Panel(py3_2.out)
pt_3 = Point(py3_2.Agent_Geo)
srf_2 = Surface(crv_5)
panel_8 = Panel(py3.out)  # disabled
srf_3 = Surface(crv)
srf_4 = Surface(crv_4)
panel_9 = Panel(py3_3.out)  # disabled
srf_5 = Surface(crv_2)  # disabled
srf_6 = Surface(crv_9)  # disabled
srf_7 = Surface(crv_10)  # disabled
pt_4 = Point(py3_3.Agent_Geo)  # disabled
swatch = ColourSwatch(SwatchColor=RGBA(5, 243, 0, 134))  # disabled
panel_10 = Panel(py3_3.sim_active)  # disabled
cir = Circle(Plane=pt_2, Radius=0.2)  # disabled
cir_2 = Circle(Plane=pt_3, Radius=0.2)
cir_3 = Circle(Plane=pt_4, Radius=0.2)  # disabled
preview = CustomPreview(Geometry=srf_2, Material=ColourSwatch(SwatchColor=RGBA(5, 243, 0, 134)))
swatch_2 = ColourSwatch(SwatchColor=RGBA(255, 0, 0, 127))  # disabled
preview_2 = CustomPreview(Geometry=srf_7, Material=swatch)  # disabled
srf_8 = Surface(cir_2)
preview_3 = CustomPreview(Geometry=srf_3, Material=ColourSwatch(SwatchColor=RGBA(255, 0, 0, 127)))
srf_9 = Surface(cir_3)  # disabled
preview_4 = CustomPreview(Geometry=srf_5, Material=swatch_2)  # disabled
number_slider_8 = Slider(1.7, range=0..10)  # disabled
Z = UnitZ(Factor=Slider(1.7, range=0..10))
Z_2 = UnitZ(Factor=number_slider_8)  # disabled
extr = Extrude(Direction=Z)
extr_2 = Extrude(Direction=Z_2)  # disabled
